# Grasshopper definition automation.gh (Grasshopper 1.0.8)

panel = Panel("""-3.6
-1.2
2""")
panel_2 = Panel("""-3.6
1.2
2""")
flatten = FlattenTree(Tree=panel, Path="{0}")  # -> simplify(graft(Tree))
flatten_2 = FlattenTree(Tree=panel_2, Path="{0}")  # -> simplify(graft(Tree))
bang = ExplodeTree(Data=flatten)  # -> Branch0, Branch1, Branch2
bang_2 = ExplodeTree(Data=flatten_2)  # -> Branch0, Branch1, Branch2
pt = ConstructPoint(XCoordinate=bang.Branch0, YCoordinate=bang.Branch1, ZCoordinate=bang.Branch2)
width = Slider(1.25, range=0.25..2.5)
width_2 = Slider(1.25, range=0.25..2.5)
pt_2 = ConstructPoint(XCoordinate=bang_2.Branch0, YCoordinate=bang_2.Branch1, ZCoordinate=bang_2.Branch2)
input_pt = Point(pt)
wall_layers = Mesh(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)
input_pt_2 = Point(pt_2)
stud_gap = Slider(0.58, range=0.05..1)
width_b = GetNumber(width_2, AtLeast=1, AtMost=2147483647, Maximum=1.797693135e+308, Minimum=-1.797693135e+308, TreeAccess=False)
insert_a = GetPoint(input_pt, AtLeast=1, AtMost=1, Realtime=True, TreeAccess=False)
width_a = GetNumber(width, AtLeast=1, AtMost=2147483647, Maximum=1.797693135e+308, Minimum=-1.797693135e+308, TreeAccess=False)
height_a = GetNumber(
    Slider(1.8, range=1..2),
    AtLeast=1,
    AtMost=2147483647,
    Maximum=1.797693135e+308,
    Minimum=-1.797693135e+308,
    TreeAccess=False)
bbox = BoundingBox(Content=wall_layers, Plane=PlaneXY(0, 0, 0), UnionBox=True)  # -> Box, Box_2
height_b = GetNumber(
    Slider(1, range=1..2),
    AtLeast=1,
    AtMost=2147483647,
    Maximum=1.797693135e+308,
    Minimum=-1.797693135e+308,
    TreeAccess=False)
insert_b = GetPoint(input_pt_2, AtLeast=1, AtMost=1, Realtime=True, TreeAccess=False)
stud_gap_2 = GetNumber(stud_gap, AtLeast=1, AtMost=2147483647, Maximum=1.797693135e+308, Minimum=-1.797693135e+308, TreeAccess=False)
debox = DeconstructBox(Box=bbox.Box)  # -> Plane, X, Y, Z
window_2_height = Number(height_a)
window_2_width = Number(width_a)
box = EvaluateBox(Box=bbox.Box, UParameter=Slider(0.5, range=0..1), VParameter=Slider(0, range=0..1), WParameter=Slider(0, range=0..1))  # -> Plane, Point, Include
window_2_height_2 = Number(height_b)
wall_length = Number(debox.Y)
window_2_width_2 = Number(width_b)
Y = UnitY(Factor=1)
division = Division(A=wall_length, B=stud_gap_2)
round = Round(Number=division)  # -> Nearest, Floor, Ceiling
amp = Amplitude(Vector=Y, Amplitude=wall_length)
xz = XZPlane(Origin=box.Point)
dom = ConstructDomain(DomainStart=expr("x*-0.5", window_2_width), DomainEnd=expr("x*0.5", window_2_width))
dom_2 = ConstructDomain(DomainStart=expr("x*-0.5", window_2_height), DomainEnd=expr("x*0.5", window_2_height))
yz = YZPlane(Origin=insert_a)
move = Move(Geometry=xz, Motion=amp)  # -> Geometry, Transform
dom_3 = ConstructDomain(DomainStart=expr("x*-0.5", window_2_width_2), DomainEnd=expr("x*0.5", window_2_width_2))
dom_4 = ConstructDomain(DomainStart=expr("x*-0.5", window_2_height_2), DomainEnd=expr("x*0.5", window_2_height_2))
yz_2 = YZPlane(Origin=insert_b)
X = UnitX(Factor=1)
ln = Line(StartPoint=xz, EndPoint=move.Geometry)
neg = Negative(Value=X)
divide = DivideCurve(Curve=ln, Count=round.Nearest, Kinks=False)  # -> Points, Tangents, Parameters
rectangle = Rectangle(Plane=yz, XSize=dom, YSize=dom_2, Radius=0)  # -> Rectangle, Length
rectangle_2 = Rectangle(Plane=yz_2, XSize=dom_3, YSize=dom_4, Radius=0)  # -> Rectangle, Length
xz_2 = XZPlane(Origin=divide.Points)
amp_2 = Amplitude(Vector=neg, Amplitude=Slider(2, range=0..10))
panel_3 = Panel("""0
-1""")
boxrec = BoxRectangle(Rectangle=rectangle.Rectangle, Height=Domain(0, 10))
boxrec_2 = BoxRectangle(Rectangle=rectangle_2.Rectangle, Height=Domain(0, 10))
cull_i = CullIndex(List=xz_2, Indices=panel_3, Wrap=True)
move_2 = Move(Geometry=boxrec, Motion=amp_2)  # -> Geometry, Transform
move_3 = Move(Geometry=boxrec_2, Motion=amp_2)  # -> Geometry, Transform
sdiff = SolidDifference(BrepsA=bbox.Box, BrepsB=[move_3.Geometry, move_2.Geometry])
geo = Geometry(sdiff)
sec = BrepPlane(Brep=geo, Plane=cull_i)  # -> Curves, Points
boundary = BoundarySurfaces(Edges=sec.Curves)  # -> flatten(Surfaces)
area = Area(Geometry=boundary)  # -> Area, Centroid
xz_3 = XZPlane(Origin=area.Centroid)
scale_nu = ScaleNU(Geometry=boundary, Plane=xz_3, ScaleX=Slider(0.9, range=0..1), ScaleY=Slider(0.99, range=0..1), ScaleZ=1)  # -> Geometry, Transform
md_slider = MDSlider(SliderMode=0, slider_value=Point(0.5, 0.5, 0.5), x_domain=Domain(0, 1), y_domain=Domain(0, 1), z_domain=Domain(0, 1))
Y_2 = UnitY(Factor=1)
amp_3 = Amplitude(Vector=Y_2, Amplitude=Slider(0.01, range=0.01..0.5))
iso = IsoCurve(Surface=reparameterize(scale_nu.Geometry), UVPoint=md_slider)  # -> UIsocurve, VIsocurve
volume = Volume(Geometry=sdiff)  # -> Volume, Centroid
extr = Extrude(Base=scale_nu.Geometry, Direction=amp_3)
crv = Curve(iso.UIsocurve)
crv_2 = Curve(iso.VIsocurve)
lng = ListLength(List=extr)
merge = Merge(Data1=crv, Data2=crv_2)
len = Length(Curve=merge)
sort = SortList(Keys=len, ValuesA=merge)  # -> Keys, reverse(ValuesA)
item = ListItem(List=sort.ValuesA, Index=0, Wrap=True)  # -> flatten(Item)
len_2 = Length(Curve=item)
ma = MassAddition(Input=len_2)  # -> Result, PartialResults
round_2 = Round(Number=ma.Result)  # -> Nearest, Floor, Ceiling

# ---- group: RH_OUT:Total_Studs_Length
num = Number(round_2.Ceiling)

# ---- group: RH_OUT:Studs
mesh = Mesh(extr)

# ---- group: RH_OUT:Vertical_Studs_Count
num_2 = Number(lng)

# ---- group: RH_OUT:Wall
mesh_2 = Mesh(sdiff)

# ---- group: RH_OUT:Volume
num_3 = Number(volume.Volume)
